test file "Osc1CarrierTest"

suite "Test Basic Carrier"

  case "Test Pure Square 480Hz" [baseline]
    description: Generate a pure square signal at 480Hz on two cycles:
      - PW is null
      - No slope
      - No pitch
    model Alpha3, harness Osc1CarrierTestHarness (for Alpha3/Voice/DCO/Generate Sample/OSC1/Osc1Sampling/Carrier), stop time 200
    input "Osc1CarrierSquarePw0.mat", mapped to freq, p_freq_ratio, pitch, pw_percent, slope_percent (active)

  case "Test Max PW 480Hz" [baseline]
    description: Generate a flat signal at 480Hz on two cycles:
      - PW is set to its maximum
      - No slope
      - No pitch
      When the pulse width is set to its maximum, the generated carrier is silent, remaining at a constant sample value.
    model Alpha3, harness Osc1CarrierTestHarness (for Alpha3/Voice/DCO/Generate Sample/OSC1/Osc1Sampling/Carrier), stop time 200
    input "Osc1CarrierSquarePw100.mat", mapped to freq, p_freq_ratio, pitch, pw_percent, slope_percent (active)